# Grasshopper definition ASSIGNMENT II_SOFIA KAKOURI.gh (Grasshopper 1.0.7)
# plug-ins: Firefly.Core

ports_available = COMPortsAvailable()
panel = Panel(ports_available)
toggle = BooleanToggle(True)
cyl = Cylinder(Base=PlaneXY(0, 0, 0), Radius=Slider(1.4, range=0..10), Length=Slider(10, range=0..20))
item = ListItem(List=panel, Index="0", Wrap=True)
panel_2 = Panel(item)
divide = DivideDomain²(Domain=cyl, UCount=Slider(6, range=0..20), VCount=Slider(10, range=0..20))
open_port = OpenClosePort(OpenClosePort=toggle, PortNumber=panel_2, BaudRate="9600")
subsrf = Isotrim(Surface=cyl, Domain=divide)
panel_3 = Panel(open_port)
timer = Timer(TimerInterval=5000, Target=read)
debrep = DeconstructBrep(Brep=subsrf)  # -> Faces, Edges, Vertices
read = SerialReadGeneric(StartReadingValues=toggle, PortNumber=panel_2)  # -> SerialOutput, StatusMessage
panel_4 = Panel(subsrf)
cull = CullPattern(List=debrep.Vertices, CullPattern=[False, False, True, True])
panel_5 = Panel(read.SerialOutput)
dispatch = Dispatch(List=cull, DispatchPattern=[True, False])  # -> ListA, ListB
split = TextSplit(Text=panel_5, Separators=",")
item_2 = ListItem(List=panel_4, Index="59", Wrap=True)
subtraction = Subtraction(A=dispatch.ListB, B=dispatch.ListA)
list = ValueList({"london", "nicosia", "los angeles", "tehran", "berlin", "tokyo", "cape town", "athens"}, selected="nicosia")
panel_6 = Panel(split)
panel_7 = Panel(item_2)
vdis = VectorDisplay(Anchor=dispatch.ListA, Vector=subtraction)
python = PythonScript(apiKey="66d3115d67bde16c3c0d4a520190db6d", city=list)  # -> out, weather, location
# ---------- python: Python ----------
from System.Net import WebClient
import json

url = "https://api.openweathermap.org/data/2.5/weather?q=" + city + "&appid=" + apiKey
#print(url)

file = WebClient().DownloadString(url)
#print file

dict = json.loads(file)

weather = dict["weather"][0]["main"]
location = dict["name"]

print(dict)
# ---------- end python ----------
item_3 = ListItem(List=panel_6, Index="1", Wrap=True)
panel_8 = Panel(python.weather)
remap = RemapNumbers(Value=item_3, Source="0 To 1", Target=Domain(0, 1))  # -> Mapped, Clipped
panel_9 = Panel(remap.Mapped)
python_2 = PythonScript(weather=panel_8)  # -> angle
# ---------- python_2: Python ----------
from math import pi

weather = str(weather).lower()
maxAngle = 0.8*pi

if weather == "drizzle":
    angle = 0.2*maxAngle
elif weather == "clouds":
    angle = 0.5*maxAngle
elif weather == "rain":
    angle = 0
elif weather == "clear":
    angle = maxAngle
elif weather == "mist":
    angle = 0.1*maxAngle
else:
    angle = 0
# ---------- end python_2 ----------
panel_10 = Panel(python_2)
multiplication = Multiplication(A=panel_10, B=panel_5)
rot3d = Rotate3D(Geometry=item_2, Angle=multiplication, Center=dispatch.ListA, Axis=subtraction)  # -> Geometry, Transform
rot3d_2 = Rotate3D(Geometry=debrep.Faces, Angle=panel_10, Center=dispatch.ListA, Axis=subtraction)  # -> Geometry, Transform
